# Grasshopper definition 01_addition.gh (Grasshopper 1.0.8)
# plug-ins: Tunny

A = Slider(1, range=0..1)
B = Slider(1, range=0..1)
addition = Addition(A=A, B=B)
result = Number(addition)
fishing = TunnyFishing(Variables=[A, B], Objectives=result)  # -> Info, Fishes
