# Grasshopper definition 02_attr_and_artf.gh (Grasshopper 1.0.8)
# plug-ins: Tunny

scale_factor = Slider(0.27, range=0.1..2)
geo = Geometry([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])
scale = Scale(Geometry=geo, Center=Point(0, 0, 0), Factor=scale_factor)  # -> Geometry, Transform
volume = Volume(Geometry=scale.Geometry)  # -> Volume, Centroid
ma = MassAddition(Input=volume.Volume)  # -> Result, PartialResults
volume_2 = Number(ma.Result)

# ----
# The constraint is considered satisfied
# if the input value falls below 0.
number_slider = Slider(30, range=0..100)
subtraction = Subtraction(A=ma.Result, B=number_slider)
subtraction_2 = Subtraction(A=Slider(15, range=0..100), B=ma.Result)

# ----
# The geometry itself can be saved
# and viewed as a 3d model
# from the dashboard
panel = Panel("Rhino logo scale:")
concat = Concatenate(FragmentA=panel, FragmentB=scale_factor)

# ----
# The geometry itself can be saved
# and viewed as a 3d model
# from the dashboard
geo_2 = Geometry(scale.Geometry)

# ----
# You can also capture the geometry of interest
# and view the image on the dashboard.
fpcap = FishPrintByCapture()

constrfa = ConstructFishAttribute(Constraint=[subtraction_2, subtraction], Attr1=concat)
tunny = Tunny(Variables=scale_factor, Objectives=volume_2, Attributes=constrfa, Artifacts=[geo_2, fpcap])  # -> Info, Fishes
