# Grasshopper definition 03_human_in_the_loop.gh (Grasshopper 1.0.8)
# plug-ins: Tunny, LunchBox

facadetype = TunnyValueList({"Diagonal": 1, "Vertical": 2}, selected="Vertical")
u_division = Slider(10, range=5..10)
scalex = Slider(0.3, range=0.3..0.99)
scaley = Slider(0.3, range=0.3..0.99)
v_division = Slider(10, range=5..10)

crv = Curve(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)
evalsrf = EvaluateSurface(Surface=crv, Point="0,0")  # -> Point, Normal, UDirection, VDirection, Frame
pt = Point(evalsrf.Point)
vec = Vector(evalsrf.Frame)
pln = Plane(evalsrf.Frame)

crv_2 = Curve(crv)
diamond = DiamondPanels(Surface=crv_2, UDivisions=u_division, VDivisions=v_division)  # -> DiamondPanels, TriPanels
crv_3 = Curve(crv)
crv_4 = Curve(crv)
merge = Merge(Data1=diamond.DiamondPanels, Data2=diamond.TriPanels)
quads = QuadPanels(Surface=crv_3, UDivisions=u_division, VDivisions="1")
quads_2 = QuadPanels(Surface=crv_4, UDivisions="1", VDivisions=v_division)
area = Area(Geometry=merge)  # -> Area, Centroid
area_2 = Area(Geometry=quads)  # -> Area, Centroid
area_3 = Area(Geometry=quads_2)  # -> Area, Centroid
pt_2 = Point(pt)
vec2pt = Vector2Pt(PointA=pt_2, PointB=area.Centroid, Unitize=False)  # -> Vector, Length
pln_2 = Plane(pln)
pt_3 = Point(pt)
pt_4 = Point(pt)
vec2pt_2 = Vector2Pt(PointA=pt_3, PointB=area_2.Centroid, Unitize=False)  # -> Vector, Length
move = Move(Geometry=pln_2, Motion=vec2pt.Vector)  # -> Geometry, Transform
pln_3 = Plane(pln)
vec2pt_3 = Vector2Pt(PointA=pt_4, PointB=area_3.Centroid, Unitize=False)  # -> Vector, Length
pln_4 = Plane(pln)
move_2 = Move(Geometry=pln_3, Motion=vec2pt_2.Vector)  # -> Geometry, Transform
scale_nu = ScaleNU(Geometry=merge, Plane=move.Geometry, ScaleX=scalex, ScaleY=scaley, ScaleZ=1)  # -> flatten(Geometry), Transform
move_3 = Move(Geometry=pln_4, Motion=vec2pt_3.Vector)  # -> Geometry, Transform
scale_nu_2 = ScaleNU(Geometry=quads, Plane=move_2.Geometry, ScaleX=scalex, ScaleY=1, ScaleZ=1)  # -> flatten(Geometry), Transform
debrep = DeconstructBrep(Brep=scale_nu.Geometry)  # -> Faces, flatten(Edges), Vertices
crv_5 = Curve(crv)
scale_nu_3 = ScaleNU(Geometry=quads_2, Plane=move_3.Geometry, ScaleX=1, ScaleY=scaley, ScaleZ=1)  # -> flatten(Geometry), Transform
debrep_2 = DeconstructBrep(Brep=scale_nu_2.Geometry)  # -> flatten(Faces), flatten(Edges), Vertices
srfsplit = SurfaceSplit(Surface=crv_5, Curves=debrep.Edges)
crv_6 = Curve(crv)
debrep_3 = DeconstructBrep(Brep=scale_nu_3.Geometry)  # -> flatten(Faces), flatten(Edges), Vertices
crv_7 = Curve(crv)
rdiff = RegionDifference(CurvesA=crv_6, CurvesB=debrep_2.Faces)
item = ListItem(List=srfsplit, Index=0, Wrap=True)
rdiff_2 = RegionDifference(CurvesA=crv_7, CurvesB=debrep_3.Faces)
srf_horizontal = Surface(rdiff_2)
srf_vertical = Surface(rdiff)
srf_lattice = Surface(item)

fpcap = FishPrintByCapture()
tunny = Tunny(Variables=[facadetype, u_division, v_division, scalex, scaley], Objectives=fpcap)  # -> Info, Fishes

lattice_h = Slider(0.5, range=0.01..1)
vertical_h = Slider(0.5, range=0.01..1)
horizontal_h = Slider(0.5, range=0.01..1)
vec_2 = Vector(vec)
vec_3 = Vector(vec)
vec_4 = Vector(vec)
multiplication = Multiplication(A=vec_2, B=lattice_h)
srf_lattice_2 = Surface(srf_lattice)
srf_horizontal_2 = Surface(srf_horizontal)
multiplication_2 = Multiplication(A=vec_3, B=vertical_h)
srf_vertical_2 = Surface(srf_vertical)
multiplication_3 = Multiplication(A=vec_4, B=horizontal_h)
extr = Extrude(Base=srf_vertical_2, Direction=multiplication_2)  # -> flatten(Extrusion)
extr_2 = Extrude(Base=srf_horizontal_2, Direction=multiplication_3)  # -> flatten(Extrusion)
extr_3 = Extrude(Base=srf_lattice_2, Direction=multiplication)  # -> flatten(Extrusion)
brep_lattice = Brep(extr_3)
brep_vertical = Brep(extr)
brep_horizontal = Brep(extr_2)

brep_vertical_2 = Brep(brep_vertical)
brep_horizontal_2 = Brep(brep_horizontal)
equals = Equality(FirstNumber=facadetype, SecondNumber="1")  # -> Equality, Inequality
merge_2 = Merge(Data1=brep_vertical_2, Data2=brep_horizontal_2)
brep_lattice_2 = Brep(brep_lattice)
cull = CullPattern(List=brep_lattice_2, CullPattern=equals.Equality)
cull_2 = CullPattern(List=merge_2, CullPattern=equals.Inequality)
crv_8 = Curve(crv)
srf = Surface(crv_8)
preview = CustomPreview(Geometry=srf, Material=ColourSwatch(SwatchColor=RGBA(82, 191, 255, 179)))
preview_2 = CustomPreview(Geometry=[cull, cull_2], Material=ColourSwatch(SwatchColor=RGB(255, 255, 255)))
